# Grasshopper definition cea_grasshopper_part4.gh (Grasshopper 1.0.7)
# plug-ins: cea-grasshopper

# ----
# CEA file paths
path_to_your_scenario = Panel("D:\ZS\CEA_test\2020_05_12")
cea_file_paths = CEAFilePaths(scenario=path_to_your_scenario)  # -> scenario_3, path_zone_2, path_surroundings_2, path_streets_2, path_typology_2

crv_building_footprints_zone = Curve()
crv_building_footprints_surroundings = Curve()

# ---- group: to zone.shp
# to surroundings.shp
num_floor_height = Slider(3.5, range=0..10)
txt_name_zone = Text(["B_001", "B_002", "B_003", "B_004", "B_005", "B_006", "B_007", "B_008", "B_009"])
num_floors_ag_zone = Number([3, 3, 22, 28, 23, 3, 35, 29, 21])
num_floors_bg_zone = Number([0, 0, 0, 0, 0, 0, 0, 0, 0])
# to zone.shp
panel = Panel(txt_name_zone)
multiplication = Multiplication(A=num_floors_ag_zone, B=num_floor_height)
multiplication_2 = Multiplication(A=num_floors_bg_zone, B=num_floor_height)
num_height_ag_zone = Number(multiplication)
num_height_bg_zone = Number(multiplication_2)
panel_2 = Panel(num_floors_ag_zone)
merge = Merge(
    Data1=graft(txt_name_zone),
    Data2=graft(num_floors_ag_zone),
    Data3=graft(num_floors_bg_zone),
    Data4=graft(num_height_ag_zone),
    Data5=graft(num_height_bg_zone))
panel_3 = Panel(num_floors_bg_zone)
field_values = Panel(merge)
path_surroundings = Panel(cea_file_paths.path_zone_2)
fieldname_type_length = Panel("""Name;C;80
floors_ag;F;10;0
floors_bg;F;10;0
height_ag;F;10;1
height_bg;F;10;1""")
crv_building_footprints_zone_2 = Curve(graft(crv_building_footprints_zone))
list = ValueList({"NULL": 0, "POINT": 1, "POLYLINE": 3, "POLYGON": 5, "MULTIPOINT": 8, "POINTZ": 11, "POLYLINEZ": 13, "POLYGONZ": 15, "MULTIPOINTZ": 18, "POINTM": 21, "POLYLINEM": 23, "POLYGONM": 25, "MULTIPOINTM": 28, "MULTIPATCH": 31}, selected="POLYGON")
geometry = Panel(crv_building_footprints_zone_2)
shp_export = ShapefileExport(
    path=path_surroundings,
    shape_type=list,
    geometry=crv_building_footprints_zone_2,
    fields=fieldname_type_length,
    records=field_values,
    enc="ISO-8859-1",
    write=Toggle(False))  # -> out; inputs path: tree, shape_type: tree, geometry: tree, fields: tree, records: tree, enc: tree, write: Boolean
# ---------- shp_export: Python ----------
# -*- coding: utf-8 -*-

# Source code available at https://github.com/hiteca

"""
Export geometry and data to ESRI Shapefile.

    Args:
        path: Path to exported .shp file
        shape_type: pyShp shape type (1 - point, 3 - polyline, 5 - polygon...). See full list at https://github.com/GeospatialPython/pyshp
        geometry: Geometry to export
        fields: List of fields (format - "name|type|length")
        records: Data rows. Each row in own branch
        enc: File encoding. 
                Default - utf-8 
        write: [bool] Connect button or toggle to write file
"""
ghenv.Component.Name = "Shapefile Export"
ghenv.Component.NickName = 'Shp Export'
ghenv.Component.IconDisplayMode = ghenv.Component.IconDisplayMode.icon
ghenv.Component.Category = "Extra"
ghenv.Component.SubCategory = "Hiteca"
try: ghenv.Component.AdditionalHelpFromDocStrings = "2"
except: pass


import sys

import System
import clr
import os
clr.AddReference("Grasshopper")
from Grasshopper.Kernel.Data import GH_Path
from Grasshopper import DataTree

import Grasshopper.Kernel as gh

we = gh.GH_RuntimeMessageLevel.Error
ww = gh.GH_RuntimeMessageLevel.Warning

try:
    import shapefile
except:
    message = "Python module 'pyshp' not found. Please download it and install to Rhino IronPython folder using manual at https://github.com/hiteca/ghshp"
    ghenv.Component.AddRuntimeMessage(we, message)
    message = "https://github.com/hiteca/ghshp#install-pyshp"
    ghenv.Component.AddRuntimeMessage(we, message)

import rhinoscriptsyntax as rs

def list2branch(source_tree,data,item_index,data_path):
    _p = GH_Path(data_path).AppendElement(item_index)
    for i in range(len(data)):
        _data = data[i]
        if type(_data) == list:
            soruce_tree = v2branch(source_tree,_data,i,_p)
        else:
            source_tree.AddRange([_data],GH_Path(_p))
    return source_tree
    

def py_tree(source_tree, reverse=False, default=None):
    if not reverse:
        result = {}
        for i in range(len(source_tree.Branches)):
            d = source_tree.Branches[i]
            p = GH_Path(source_tree.Paths[i])
            
            result[p] = list(d)
        if len(result.keys())==0:
            result[GH_Path(0)] = [default]
    else:
        result = DataTree[System.Object]()
        for p in source_tree.keys():
            d = source_tree[p]
            _d = []
            for j in range(len(d)):
                data = d[j]
                if type(data) == list:
                    result = list2branch(result,data,j,p)
                else:
                    _d.append(data)
            if len(_d) > 0:
                result.AddRange(_d,p)
                
    return result


def repeat_latest(data,length):
    if len(data) > length:
        return data[:length]
    else:
        return data + ([data[-1]] * (length - len(data)))


def graft_tree(t):
    r = {}
    for k,v in t.items():
        for i in range(len(v)):
            r[GH_Path(k).AppendElement(i)] = [v[i]]
    return r
    
    
def longest_list(t_a,t_b):
    r_b = {}
    r_a = {}
    prev_a = t_a.items()[0][1]
    prev_b = t_b.items()[0][1]
    
    if len(t_a) >= len(t_b):
        keys = t_a.keys()
    else:
        keys = t_b.keys()

    keys = sorted(keys, key=lambda x: str(GH_Path(x)))

    for k in keys:
        try:
            branch_a = t_a[k]
            prev_a = t_a[k]
        except:
            branch_a = prev_a
        try:
            branch_b = t_b[k]
            prev_b = t_b[k]
        except:
            branch_b = prev_b
        max_len = max(len(branch_b),len(branch_a))
        if len(branch_b) >= len(branch_a):
            branch_a = repeat_latest(branch_a, len(branch_b))
        else:
            branch_b = repeat_latest(branch_b, len(branch_a))
        r_a[k] = branch_a
        r_b[k] = branch_b
        
    return(r_a,r_b)


shape_types = {
    "point" : [
        1, #POINT
        8, #MULTIPOINT
        11, #POINTZ
        18, #MULTIPOINTZ
        21, #POINTM
        28, #MULTIPOINTM
    ],
    "polyline": [
        3, #POLYLINE
        5, #POLYGON
        13, #POLYLINEZ
        15, #POLYGONZ
        23, #POLYLINEM
        25, #POLYGONM
        31, #MULTIPATCH
    ]
}

def find_type(t):
    for k in shape_types.keys():        
        if t in shape_types[k]:
            return k
            


def list2point(pt):
    if len(pt)==2:
        pt.append(0)
    return rc.Geometry.Point3d(pt[0],pt[1],pt[2])


def write_shapefile(file_path, st, geom, fields, data, enc):
    w = shapefile.Writer(shapeType=st)
    sf_type = find_type(st)

    records_dict = {}
    # create fields
    for f in fields:
        _f = f.split(";")
        if len(_f) == 3:
            f_name, f_type, f_len = _f
            f_len2 = 0
        else:
            f_name, f_type, f_len, f_len2 = _f
        w.field(f_name, f_type, int(f_len), int(f_len2))

    # generate geometry
    for geom_branch in geom:
        parts = []
        if sf_type == "point":
            for point in geom_branch:
                parts.append(list(point))
            parts = [parts]
        else:
            for polyline in geom_branch:
                parts_p = []
                points = rs.CurvePoints(polyline)
                for p in points:
                    parts_p.append(list(p))
                parts.append(parts_p)
        w.poly(parts=parts,shapeType=st)
    
    for record in data:
        # TEMP
        # encode strings to ASCII with ignore
        # to prevent the same exception in pyshp
        r = [r.encode("ascii", 'ignore') if type(r) in [str, unicode] else r for r in record]
        w.record(*r)
    
    try:
        w.save(file_path)
        print("Write successful - %s" % file_path)
    except Exception as e:
        print(isinstance(e,UnicodeEncodeError))
        print("Error with writing %s" % file_path,e)
    

path = py_tree(path)
geometry = py_tree(geometry)
shape_type = py_tree(shape_type)
fields = py_tree(fields)
records = py_tree(records)
enc = py_tree(enc, default="utf-8")

def shift_path(d):
    new_dict = {}
    for k,v in d.items():
        _k = k.CullElement()
        if _k not in new_dict.keys():
            new_dict[_k] = []
        new_dict[_k].append(v)
    return new_dict


def write_many(path, shape_type, geometry, fields, records, enc):
    for k,v in path.items():
        
        _geometry = geometry[k]
        write_shapefile(path[k][0], shape_type[k][0], geometry[k], fields[k], 
                        records[k], enc[k][0])


if write == True:
    _path, geometry = longest_list(path,geometry)
    _path, shape_type = longest_list(path,shape_type)
    _path, fields = longest_list(path,fields)
    _path, records = longest_list(path,records)
    _path, enc = longest_list(path,enc)

    geometry = shift_path(geometry)
    records = shift_path(records)

    write_many(path, shape_type, geometry, fields, records, enc)
# ---------- end shp_export ----------

# ---- group: to surroundings.shp
num_floor_height_2 = Slider(3.5, range=0..10)
txt_name_surroundings = Text(["S_001", "S_002", "S_003", "S_004", "S_005", "S_006", "S_007", "S_008", "S_009", "S_010", "S_011", "S_012", "S_013"])
num_floors_ag_surroundings = Number([3, 24, 31, 3, 28, 35, 3, 3, 37, 26, 3, 30, 53])
num_floors_bg_surroundings = Number([0, 0, 0, 0, 0, 0, 0, 0, 0, 0, 0, 0, 0])
panel_4 = Panel(txt_name_surroundings)
multiplication_3 = Multiplication(A=num_floors_ag_surroundings, B=num_floor_height_2)
# to streets.shp
multiplication_4 = Multiplication(A=num_floors_bg_surroundings, B=num_floor_height_2)
num_height_ag_surroundings = Number(multiplication_3)
num_height_bg_surroundings = Number(multiplication_4)
panel_5 = Panel(num_floors_ag_surroundings)
merge_2 = Merge(
    Data1=graft(txt_name_surroundings),
    Data2=graft(num_floors_ag_surroundings),
    Data3=graft(num_floors_bg_surroundings),
    Data4=graft(num_height_ag_surroundings),
    Data5=graft(num_height_bg_surroundings))
panel_6 = Panel(num_floors_bg_surroundings)
field_values_2 = Panel(merge_2)
path_surroundings_2 = Panel(cea_file_paths.path_surroundings_2)
fieldname_type_length_2 = Panel("""Name;C;80
floors_ag;F;10;0
floors_bg;F;10;0
height_ag;F;10;1
height_bg;F;10;1""")
crv_building_footprints_surroundings_2 = Curve(graft(crv_building_footprints_surroundings))
list_2 = ValueList({"NULL": 0, "POINT": 1, "POLYLINE": 3, "POLYGON": 5, "MULTIPOINT": 8, "POINTZ": 11, "POLYLINEZ": 13, "POLYGONZ": 15, "MULTIPOINTZ": 18, "POINTM": 21, "POLYLINEM": 23, "POLYGONM": 25, "MULTIPOINTM": 28, "MULTIPATCH": 31}, selected="POLYGON")
geometry_2 = Panel(crv_building_footprints_surroundings_2)
shp_export_2 = ShapefileExport(
    path=path_surroundings_2,
    shape_type=list_2,
    geometry=crv_building_footprints_surroundings_2,
    fields=fieldname_type_length_2,
    records=field_values_2,
    enc="ISO-8859-1",
    write=Toggle(False))  # -> out; inputs path: tree, shape_type: tree, geometry: tree, fields: tree, records: tree, enc: tree, write: Boolean; same code as shp_export

# ----
crv_street_centerlines = Curve(flatten([<curve referenced from the Rhino model> x21]))

# ---- group: to streets.shp
crv_street_centerlines_2 = Curve(graft(crv_street_centerlines))
len = Length(Curve=crv_street_centerlines_2)
field_values_3 = Panel(len)
fieldname_type_length_3 = Panel("len;F;10;1")
path_streets = Panel(cea_file_paths.path_streets_2)
list_3 = ValueList({"NULL": 0, "POINT": 1, "POLYLINE": 3, "POLYGON": 5, "MULTIPOINT": 8, "POINTZ": 11, "POLYLINEZ": 13, "POLYGONZ": 15, "MULTIPOINTZ": 18, "POINTM": 21, "POLYLINEM": 23, "POLYGONM": 25, "MULTIPOINTM": 28, "MULTIPATCH": 31}, selected="POLYGON")
geometry_3 = Panel(crv_street_centerlines_2)
shp_export_3 = ShapefileExport(
    path=path_streets,
    shape_type=list_3,
    geometry=crv_street_centerlines_2,
    fields=fieldname_type_length_3,
    records=field_values_3,
    enc="ISO-8859-1",
    write=Toggle(False))  # -> out; inputs path: tree, shape_type: tree, geometry: tree, fields: tree, records: tree, enc: tree, write: Boolean; same code as shp_export

# ----
path_typology = Text(cea_file_paths.path_typology_2)
scenario = Text(cea_file_paths.scenario_3)

# ----
# to typology.dbf
path_to_typology_xlsx = Panel("D:\ZS\CEA_test\2020_05_12\inputs\building-properties\typology.xlsx")
panel_7 = Panel(path_typology)
dbf_to_excel_to_dbf = DBFToExcelToDBF(
    Start=Toggle(False),
    DbfToolsInputFile=path_to_typology_xlsx,
    DbfToolsOutputPath=panel_7,
    DbfToolsOutputFileName="typology")

# ---- group: inputs
# CEA commands
toggle = BooleanToggle(False)
panel_8 = Panel(scenario)

# ---- group: Data management
data_initializer = DatabaseInitializer(
    Start=toggle,
    GeneralScenario=panel_8,
    DataInitializerDatabasesPath="SG",
    DataInitializerDatabases="archetypes, assemblies, components")
panel_9 = Panel("comfort, architecture, air-conditioning, internal-loads, supply, schedules")
weather_helper = WeatherHelper(Start=data_initializer, WeatherHelperWeather="singapore")
archetypes_mapper = ArchetypesMapper(Start=weather_helper, ArchetypesMapperInputDatabases=panel_9)
schedule_maker = BuildingSchedules(Start=archetypes_mapper)

# ---- group: Solar radiation
radiation = BuildingSolarRadiation(Start=schedule_maker)

# ---- group: Demand simulation
demand = BuildingEnergyDemand(Start=radiation)

# ==== cluster CEAFilePaths
scenario = ClusterInput()
scenario_2 = Text(scenario)
scenario_3 = ClusterOutput(scenario_2)
join = TextJoin(Text=[scenario_2, "\inputs\networks\streets.shp"])
join_2 = TextJoin(Text=[scenario_2, "\inputs\building-properties\"])
join_3 = TextJoin(Text=[scenario_2, "\inputs\building-geometry\zone.shp"])
join_4 = TextJoin(Text=[scenario_2, "\inputs\building-geometry\surroundings.shp"])
path_zone = Text(join_3)
path_surroundings = Text(join_4)
path_typology = Text(join_2)
path_streets = Text(join)
path_zone_2 = ClusterOutput(path_zone)
path_streets_2 = ClusterOutput(path_streets)
path_typology_2 = ClusterOutput(path_typology)
path_surroundings_2 = ClusterOutput(path_surroundings)
